# Grasshopper definition agent_panelization.gh (Grasshopper 1.0.8)
# plug-ins: Human

surface_u_division = Slider(40, range=0..100)
surface_v_division = Slider(30, range=0..100)
size_in_x_dir = Slider(30, range=0..100)
size_in_y_dir = Slider(30, range=0..100)
amplitude = Slider(2.5, range=0..10)
scale = Slider(2.2, range=0..10)
python_3_script = Python3Script(
    seed="10",
    sizeX=size_in_x_dir,
    sizeY=size_in_y_dir,
    divU=surface_u_division,
    divV=surface_v_division,
    amplitude=amplitude,
    scale=scale)  # -> out_surface; inputs seed: Int32, sizeX: Double, sizeY: Double, divU: Int32, divV: Int32, amplitude: Double, scale: Double
# ---------- python_3_script: Python ----------
#r: numpy
import numpy as np
import rhinoscriptsyntax as rs
import random

# -------------------------------
# GH PYTHON INPUTS
# -------------------------------
# 1. Surface Dimensions
# sizeX: float (Size in X direction)
# sizeY: float (Size in Y direction)
#
# 2. Resolution
# divU: int (Number of divisions in U)
# divV: int (Number of divisions in V)
#
# 3. Heightmap Parameters
# amplitude: float (Heightmap scale factor)
# scale: float (Noise frequency/scale)
# seed: int (Random seed for reproducibility)
# -------------------------------


# -------------------------------
# Helpers
# -------------------------------

def seed_everything(seed):  # sets random seeds for reproducibility
    if seed is None:
        return
    try:
        random.seed(seed)
        np.random.seed(seed)
    except Exception as e:
        print(f"Failed to set random seeds: {e}")


# -------------------------------
# Perlin Noise Helpers
# -------------------------------

def fade(t):
    return 6 * t**5 - 15 * t**4 + 10 * t**3  # fade function smooths the interpolation

def lerp(a, b, t):
    return a + t * (b - a)  # linear interpolation between a and b

DIRECTIONS = np.array([[0, 1], [0, -1], [1, 0], [-1, 0]])  # define gradient directions (up, down, left, right) once

# -------------------------------
# 1) Heightmap Generation
# -------------------------------

def generate_heightmap(U, V, amplitude=1.0, scale=10.0, seed=None):  # computes a scalar field H over U,V using Perlin Noise
    
    if seed is not None:
        np.random.seed(seed)
        
    H = np.zeros((divU, divV))
    
    # --- Prepare Gradient Grid ---
    # Determine grid size based on scale
    grid_height = int(divU // scale) + 2
    grid_width = int(divV // scale) + 2
    
    # Generate random gradients once for the whole grid
    index = np.random.randint(0, 4, size=(grid_height, grid_width))
    gradients = DIRECTIONS[index]
    
    # --- Compute Noise ---
    for i in range(divU):  # vertical position (row)
        for j in range(divV):  # horizontal position (column)

            # Map the (i, j) index to a coordinate between 0 and 1, then scale it
            scaled_i = i / divU * scale
            scaled_j = j / divV * scale

            # Determine which cell the point belongs to (x0, y0, x1, y1)
            x0 = int(scaled_j)  # left grid corner (x index)
            y0 = int(scaled_i)  # top grid corner (y index)
            x1 = x0 + 1         # right grid corner
            y1 = y0 + 1         # bottom grid corner
            
            # Local position inside the cell (0 to 1 range)
            sx = scaled_j - x0  
            sy = scaled_i - y0  

            # Apply fade to smooth the interpolation
            u = fade(sx)
            v = fade(sy)

            # Distance vectors from point to each corner 
            dx0 = sx       
            dy0 = sy       
            dx1 = sx - 1   
            dy1 = sy - 1   

            # Dot products between distance and gradient vectors
            n00 = np.dot(gradients[y0, x0], [dx0, dy0])  # top-left corner
            n10 = np.dot(gradients[y0, x1], [dx1, dy0])  # top-right corner
            n01 = np.dot(gradients[y1, x0], [dx0, dy1])  # bottom-left corner
            n11 = np.dot(gradients[y1, x1], [dx1, dy1])  # bottom-right corner

            # Interpolate along x-axis
            nx0 = lerp(n00, n10, u)  
            nx1 = lerp(n01, n11, u)  

            H[i, j] = lerp(nx0, nx1, v)  # interpolate along y-axis

    # Normalization and Amplitude scaling
    # Recenter to -1 to 1 range, then apply amplitude
    H_normalized = (H - H.min()) / (H.max() - H.min())
    H_scaled = (H_normalized * 2 - 1) * amplitude
    
    return H_scaled


# -------------------------------
# 2) Base Grid Generation
# -------------------------------

def make_flat_grid(divU, divV, sizeX, sizeY):  # creates a flat 2D list of Rhino Points on the XY plane
    
    x_vals = np.linspace(0.0, sizeX, divU)
    y_vals = np.linspace(0.0, sizeY, divV)
    X, Y = np.meshgrid(x_vals, y_vals, indexing='ij')
    Z = np.zeros(X.shape)
    
    grid = []
    for i in range(divU):
        row = []
        for j in range(divV):
            pt = rs.AddPoint(X[i, j], Y[i, j], Z[i, j])
            row.append(pt)
        grid.append(row)
        
    return grid

# -------------------------------
# 3) Grid Manipulation
# -------------------------------

def manipulate_point_grid(point_grid, heightmap):
    """
    Deforms a point grid based on the provided heightmap.
    Returns a new list of lists containing Rhino Points.
    """
    rows = len(point_grid)
    cols = len(point_grid[0])
    
    new_grid = []
    
    for i in range(rows):
        row_pts = []
        for j in range(cols):
            old_pt = point_grid[i][j]
            h = heightmap[i, j]
            
            # Create new point shifted in Z
            new_pt = rs.PointAdd(old_pt, [0, 0, h])
            row_pts.append(new_pt)
        new_grid.append(row_pts)
        
    return new_grid

# -------------------------------
# 4) Surface Construction
# -------------------------------

def build_surface(point_grid):

    if not point_grid:
        return None
        
    rows = len(point_grid)
    cols = len(point_grid[0])
    
    # Flatten the points in row-major order for rs.AddSrfPtGrid
    flat_points = [p for row in point_grid for p in row]
    
    # Create Surface
    surf = rs.AddSrfPtGrid((rows, cols), flat_points)  # rs.AddSrfPtGrid requires (rows, columns) dimensions
    
    return surf

# -------------------------------
# Pipeline
# -------------------------------

if __name__ == "__main__":
    
    # 1. Seed RNG
    seed_everything(seed)
    
    # 2. Generate Heightmap (Data)
    H = generate_heightmap(divU, divV, amplitude=amplitude, scale=scale)
    
    # 3. Create Base Grid (Geometry)
    flat_grid = make_flat_grid(divU, divV, sizeX, sizeY)
    
    # 4. Apply Heightmap
    deformed_grid = manipulate_point_grid(flat_grid, H)
    
    # 5. Build Final Surface
    surface = build_surface(deformed_grid)
    
    # 6. Outputs
    out_surface = surface
# ---------- end python_3_script ----------
vision_radius = Slider(2.315, range=0..10)
nr_of_agents = Slider(200, range=0..1000)
max_speed = Slider(0.377, range=0..10)
seperation = Slider(0.2, range=0..10)
max_slope = Slider(8.878, range=0..10)
alignment = Slider(1, range=0..10)
jitter = Slider(0.1, range=0..10)
reset = Button()
python_3_script_2 = Python3Script(
    seed="10",
    N=nr_of_agents,
    reset=reset,
    start_surface=python_3_script,
    vision_radius=vision_radius,
    max_speed=max_speed,
    max_slope=max_slope,
    alignment_weight=alignment,
    separation_weight=seperation,
    jitter=jitter)  # -> out_agents; inputs seed: Int32, N: Int32, reset: Boolean, vision_radius: Double, max_speed: Double, max_slope: Double, alignment_weight: Double, separation_weight: Double, jitter: Double
# ---------- python_3_script_2: Python ----------
import rhinoscriptsyntax as rs
import random
import numpy as np
import uuid
import sys

# increase recursion depth for Grasshopper recompute loops
try:
    sys.setrecursionlimit(2000)
except Exception:
    pass


# -------------------------------
# GH PYTHON INPUTS
# -------------------------------
# seed: int (Random seed for reproducibility)
# N: int (Initial number of agents spawned on the surface)

# reset: bool (Reinitialize the simulation when True)

# start_surface: Surface (Base surface on which agents are spawned and constrained)

# vision_radius: float (Neighbor sensing radius for agent interaction)
# max_speed: float (Maximum agent movement speed per step)
# max_slope: float (Slope threshold used to slow agents (resistance))
# alignment_weight: float (Strength of alignment to principal curvature direction)
# separation_weight: float (Strength of repulsion from nearby agents)
# jitter: float (Random perturbation applied when agents become stationary)
# -------------------------------


# -------------------------------
# Utility functions
# -------------------------------

def seed_everything(seed):  # seed random + numpy
    if seed is not None:
        random.seed(seed)
        np.random.seed(seed)

seed_everything(42)


# -------------------------------
# Helper functions
# -------------------------------

def generate_random_point_on_surface(surface):  # random UV sample
    if not surface:
        return None
    domainU = rs.SurfaceDomain(surface, 0)
    domainV = rs.SurfaceDomain(surface, 1)
    u = random.uniform(domainU[0], domainU[1])
    v = random.uniform(domainV[0], domainV[1])
    pt = rs.EvaluateSurface(surface, u, v)
    return pt if pt else None

def get_uv(surface, point):  # closest UV on surface
    if not surface or point is None:
        return None
    return rs.SurfaceClosestPoint(surface, point)

def sample_curvature(surface, uv):  # mean curvature + principal dir
    if not surface or not uv:
        return 0.0, (0.0, 0.0, 0.0)
    try:
        curv = rs.SurfaceCurvature(surface, uv)
        if not curv or len(curv) < 5:
            return 0.0, (0.0, 0.0, 0.0)
        k1 = curv[2] or 0.0
        k2 = curv[3] or 0.0
        mean_c = 0.5 * (k1 + k2)
        dir1 = tuple(curv[4]) if curv[4] else (0.0, 0.0, 0.0)
        return float(mean_c), dir1
    except Exception:
        return 0.0, (0.0, 0.0, 0.0)

def sample_slope(surface, uv, step=1e-3):  # finite diff slope
    if not surface or not uv:
        return (0.0, 0.0, 0.0), 0.0
    u, v = uv
    try:
        p0 = rs.EvaluateSurface(surface, u, v)
        pu = rs.EvaluateSurface(surface, u + step, v)
        pv = rs.EvaluateSurface(surface, u, v + step)
        if not p0 or not pu or not pv:
            return (0.0, 0.0, 0.0), 0.0
        p0 = np.array([p0.X, p0.Y, p0.Z])
        pu = np.array([pu.X, pu.Y, pu.Z])
        pv = np.array([pv.X, pv.Y, pv.Z])
    except Exception:
        return (0.0, 0.0, 0.0), 0.0

    slope_vec = (pu - p0) + (pv - p0)
    slope_mag = float(np.linalg.norm(slope_vec))
    return (slope_vec[0], slope_vec[1], slope_vec[2]), slope_mag


# Agent spawning helper
def spawn_agent_near(agent, surface, offset=0.2):  # spawn near parent
    try:
        jitter = (
            random.uniform(-offset, offset),
            random.uniform(-offset, offset),
            0.0
        )
        new_pos = rs.PointAdd(agent.position, jitter)
        uv = rs.SurfaceClosestPoint(surface, new_pos)
        if uv:
            new_pos = rs.EvaluateSurface(surface, uv[0], uv[1])
        vx = random.uniform(-0.05, 0.05)
        vy = random.uniform(-0.05, 0.05)
        return Agent(new_pos, (vx, vy, 0.0))
    except Exception:
        return None


# -------------------------------
# Core agent class
# -------------------------------

class Agent:  

    def __init__(self, position, velocity):  # initialize agent
        self.id = uuid.uuid4().hex
        self.position = position
        self.velocity = velocity
        self.age = 0
        self.is_alive = True
        self.path = [position]

        self.uv = None
        self.curvature_mean = 0.0
        self.curvature_dir = (0.0, 0.0, 0.0)
        self.slope_vector = (0.0, 0.0, 0.0)
        self.slope_magnitude = 0.0
        self.neighbors = []

    def sense(self, agents, surface, vision_radius):  # sample geometry + neighbors
        self.uv = get_uv(surface, self.position)
        if self.uv:
            self.curvature_mean, self.curvature_dir = sample_curvature(surface, self.uv)
            self.slope_vector, self.slope_magnitude = sample_slope(surface, self.uv)

        self.neighbors = []
        if vision_radius is None:
            return
        for other in agents:
            if other.id == self.id:
                continue
            try:
                d = rs.Distance(self.position, other.position)
            except Exception:
                continue
            if d is not None and d <= vision_radius:
                self.neighbors.append((other, float(d)))

    def decide(self, max_speed=0.5, max_slope=0.8,
               alignment_weight=0.05, separation_weight=0.12,
               jitter=0.01):  # update velocity
        if not self.is_alive:
            return

        # slope resistance
        slope_mag = self.slope_magnitude or 0.0
        resistance = max(0.2, 1.0 - slope_mag / max_slope) if max_slope else 1.0
        self.velocity = tuple(rs.VectorScale(self.velocity, resistance))

        # curvature alignment
        if rs.VectorLength(self.curvature_dir) > 1e-6:
            align_w = alignment_weight * (4.0 if abs(self.curvature_mean) < 0.1 else 1.0)
            c_dir = rs.VectorUnitize(self.curvature_dir)
            self.velocity = tuple(rs.VectorAdd(self.velocity, rs.VectorScale(c_dir, align_w)))

        # separation
        if self.neighbors:
            away = (0.0, 0.0, 0.0)
            for other, dist in self.neighbors:
                vec = rs.VectorCreate(self.position, other.position)
                if rs.VectorLength(vec) > 1e-9:
                    away = rs.VectorAdd(away, rs.VectorScale(rs.VectorUnitize(vec), 1.0 / max(dist, 1e-6)))
            if rs.VectorLength(away) > 1e-9:
                self.velocity = tuple(rs.VectorAdd(
                    self.velocity,
                    rs.VectorScale(rs.VectorUnitize(away), separation_weight)
                ))

        # clamp speed
        speed = rs.VectorLength(self.velocity)
        if speed > max_speed:
            self.velocity = tuple(rs.VectorScale(rs.VectorUnitize(self.velocity), max_speed))

        # jitter if stuck
        if rs.VectorLength(self.velocity) < 1e-4:
            self.velocity = tuple(rs.VectorAdd(
                self.velocity,
                (random.uniform(-jitter, jitter), random.uniform(-jitter, jitter), 0.0)
            ))

    def move(self, surface):  # move + project to surface
        if not self.is_alive:
            return
        new_pos = rs.PointAdd(self.position, self.velocity)
        uv = rs.SurfaceClosestPoint(surface, new_pos) if surface else None
        self.position = rs.EvaluateSurface(surface, uv[0], uv[1]) if uv else new_pos
        self.path.append(self.position)

    def update(self, agents, surface,
               vision_radius=1.0, max_speed=0.5,
               max_slope=0.8, alignment_weight=0.05,
               separation_weight=0.12, jitter=0.01,
               max_age=200, slope_kill=1.2,
               curvature_spawn=0.15, spawn_chance=0.02,
               max_neighbors=6):  # full lifecycle update

        if not self.is_alive:
            return None

        self.sense(agents, surface, vision_radius)
        self.decide(max_speed, max_slope, alignment_weight, separation_weight, jitter)
        self.move(surface)
        self.age += 1

        # death rules
        if self.age > max_age or self.slope_magnitude > slope_kill:
            self.is_alive = False
            return None

        # spawn rules
        prob = spawn_chance
        if abs(self.curvature_mean) > curvature_spawn:
            prob *= 3.0
        if len(self.neighbors) > max_neighbors:
            prob = 0.0

        if random.random() < prob:
            return spawn_agent_near(self, surface)

        return None


# -------------------------------
# Factory for creating agents
# -------------------------------

def build_agents(num_agents, start_surface):  # initial population
    if not start_surface or not rs.IsSurface(start_surface):
        return []
    agents = []
    for _ in range(num_agents):
        pos = generate_random_point_on_surface(start_surface)
        if pos:
            agents.append(Agent(pos, (random.uniform(-0.05, 0.05),
                                      random.uniform(-0.05, 0.05), 0.0)))
    return agents


# -------------------------------
# Grasshopper script instance (Pipeline)
# -------------------------------

class MyComponent(Grasshopper.Kernel.GH_ScriptInstance):

    def RunScript(self,
            seed: int,
            N: int,
            reset: bool,
            start_surface,
            vision_radius: float,
            max_speed: float,
            max_slope: float,
            alignment_weight: float,
            separation_weight: float,
            jitter: float):

        seed_everything(seed)

        if reset or not hasattr(self, "agents") or self.agents is None:
            self.agents = build_agents(N, start_surface)

        active_agents = []
        new_agents = []

        for agent in self.agents:
            spawned = agent.update(
                self.agents, start_surface,
                vision_radius, max_speed, max_slope,
                alignment_weight, separation_weight, jitter
            )
            if agent.is_alive:
                active_agents.append(agent)
            if spawned:
                new_agents.append(spawned)

        self.agents = active_agents + new_agents

        return self
# ---------- end python_3_script_2 ----------
trigger = Trigger(Interval=10, TimerInterval=10, Target=boids_simulator)  # disabled
boids_simulator = Python3Script(x=python_3_script_2, start_surface=python_3_script)  # -> out, out_agents, out_points, out_vectors, out_paths; inputs start_surface: Surface
# ---------- boids_simulator: Python ----------
import rhinoscriptsyntax as rs

# -------------------------------
# Retrieve agents from upstream Grasshopper component
# -------------------------------
# `x` is the upstream component instance (from agent_builder)
agents = x.agents if x and hasattr(x, "agents") else []


# -------------------------------
# Step simulation
# -------------------------------
new_agents = []

for agent in agents:
    spawned = agent.update(agents, start_surface)

    if spawned:
        new_agents.append(spawned)

agents = agents + new_agents  # combine active agents and any new spawned ones


# -------------------------------
# Visualization outputs
# -------------------------------
P = []       # positions
V = []       # velocity vectors
Paths = []   # trails / paths

for agent in agents:
    # Position
    P.append(agent.position)

    # velocity as line
    try:
        end = rs.PointAdd(agent.position, agent.velocity)
        V.append(rs.AddLine(agent.position, end))
    except Exception:
        V.append(None)

    # Path history
    if agent.path:
        Paths.append(agent.path)


# -------------------------------
# Grasshopper Outputs
# -------------------------------
out_agents = agents
out_points = P
out_vectors = V
out_paths = Paths

print("Simulator running, total agents:", len(agents))
# ---------- end boids_simulator ----------

# ---- group: Agents (Points)
deconstruct = Deconstruct(Point=boids_simulator.out_points)  # -> XComponent, YComponent, ZComponent
bounds = Bounds(Numbers=deconstruct.ZComponent)
deconstruct_domain = DeconstructDomain(Domain=bounds)  # -> Start, End
gradient = Gradient(
    LowerLimit=deconstruct_domain.Start,
    UpperLimit=deconstruct_domain.End,
    Parameter=deconstruct.ZComponent,
    stops=[0: RGB(243, 57, 0), 0.1: RGB(236, 27, 60), 0.2: RGB(210, 0, 118), 0.3: RGB(103, 0, 120), 0.4: RGB(39, 72, 161), 0.5: RGB(1, 192, 229), 0.6: RGB(18, 178, 90), 0.7: RGB(79, 186, 8), 0.8: RGB(220, 237, 32), 0.9: RGB(247, 159, 20), 1: RGB(243, 57, 0)])
custom_preview = CustomPreview(Geometry=boids_simulator.out_points, Material=gradient)

# ---- group: Tesselation
delaunay_edges = DelaunayEdges(Points=boids_simulator.out_points, Plane=PlaneXY(0, 0, 0))  # -> Connectivity, Edges
custom_preview_lineweights = CustomPreviewLineweights(
    Geometry=delaunay_edges.Edges,
    Shader=ColourSwatch(SwatchColor=RGB(69, 69, 69)),
    Thickness=Slider(1, range=0..10),
    Absolute=False)

# ---- group: Surface
create_material = CreateMaterial(
    Diffuse=ColourSwatch(SwatchColor=RGB(191, 191, 191)),
    Specular=RGB(255, 255, 255),
    Emission=RGB(0, 0, 0),
    Transparency=Slider(0.35, range=0..1),
    Shine=0)
custom_preview_2 = CustomPreview(Geometry=python_3_script, Material=create_material)
